# Grasshopper definition CustomGoal.gh (Grasshopper 1.0.7)
# plug-ins: Kangaroo2 Components, Mesh Pipe, Jellyfish

number_slider = Slider(10, range=0..10)
construct_point = ConstructPoint(XCoordinate=0, YCoordinate=0, ZCoordinate=0)
unit_z = UnitZ(Factor=1)
plane_surface = PlaneSurface(Plane=construct_point, XSize=number_slider, YSize=number_slider)
construct_point_2 = ConstructPoint(XCoordinate=0, YCoordinate=0, ZCoordinate=0)
mesh_plane = MeshPlane(Boundary=plane_surface, WidthCount=10, HeightCount=10)  # -> Mesh, Area
negative = Negative(Value=unit_z)
line_sdl = LineSDL(Start=construct_point_2, Direction=negative, Length=Slider(20, range=0..100))
curve = Curve(plane_surface)
end_points = EndPoints(Curve=line_sdl)  # -> Start, End
mesh_edges = MeshEdges(Mesh=mesh_plane.Mesh)  # -> NakedEdges, InteriorEdges, NonManifoldEdges
unit_x = UnitX(Factor=Slider(0.01, range=0..2))
unit_z_2 = UnitZ(Factor=Slider(0, range=0..20))
control_points = ControlPoints(Curve=curve)  # -> Points, Weights, Knots
point = Point(end_points.End)
divide_curve = DivideCurve(Curve=line_sdl, Count=Slider(20, range=0..100), Kinks=False)  # -> Points, Tangents, Parameters
merge = Merge(Data1=end_points.Start, Data2=end_points.End)
move = Move(Geometry=point, Motion=unit_x)  # -> Geometry, Transform
move_2 = Move(Geometry=point, Motion=unit_z_2)  # -> Geometry, Transform
removeduplicatepts = RemoveDuplicatePts(Points=control_points.Points, Tolerance=0.01)
merge_2 = Merge(Data1=mesh_edges.NakedEdges, Data2=mesh_edges.InteriorEdges)
negative_2 = Negative(Value=Slider(0.8, range=0..1))
average = Average(Input=merge)
negative_3 = Negative(Value=Slider(5, range=0..10))
polyline = PolyLine(Vertices=divide_curve.Points, Closed=False)
length = Length(Curve=merge_2)
nakedvertices = NakedVertices(Mesh=mesh_plane.Mesh)  # -> ClothedIndex, NakedIndex, ClothedPts, NakedPts
unit_z_3 = UnitZ(Factor=Slider(0.504, range=0..1))
point_charge = PointCharge(Point=move_2.Geometry, Charge=negative_2, Decay=Slider(0, range=0..1))
spin_force = SpinForce(Plane=move.Geometry, Strength=Slider(10, range=0..10), Radius=5, Decay=2)
spin_force_2 = SpinForce(Plane=average, Strength=negative_3, Radius=5, Decay=2)
multiplication = Multiplication(A=length, B=Slider(1, range=0..10))
negative_4 = Negative(Value=unit_z_3)
merge_3 = Merge(Data1=nakedvertices.ClothedPts, Data2=nakedvertices.NakedPts)
rod = Rod(Polyline=polyline, LengthFactor=1, AngleFactor=1, AxialStrength=10, BendStrength=1)
anchor = Anchor(Point=end_points.Start, Strength=10000)
merge_4 = Merge(Data1=spin_force_2, Data2=spin_force, Data3=point_charge)
show = Show(G=polyline)
line = Line(merge_2)
length_line = LengthLine(Line=merge_2, Length=multiplication, Strength=10)
load = Load(Point=merge_3, ForceVector=negative_4, Weighting=1)
length_2 = CSharpScript(
    Line=line,
    l=multiplication,
    k=Slider(10, range=0..10),
    Reference=["C:\Program Files\Rhino 7\Plug-ins\Grasshopper\Components\Kangaroo2Component.gha", "C:\Program Files\Rhino 7\Plug-ins\Grasshopper\Components\KangarooSolver.dll"])  # -> out, A; inputs Line: Line, l: Double, k: Double
# ---------- length_2: C# usings ----------
using KangarooSolver;
# ---------- length_2: C# ----------
    A = new Spring(Line.From, Line.To, l, k);
# ---------- length_2: C# additional code ----------
  public class Spring : GoalObject
  {
    public double RestLength, Stiffness;

    public Spring()
    {
    }

    public Spring(int s, int e, double l, double k)
    {
      PIndex = new int[2] { s, e };
      Move = new Vector3d[2];
      Weighting = new double[2];
      RestLength = l;
      Stiffness = k;
    }

    public Spring(Point3d s, Point3d e, double l, double k)
    {
      PPos = new Point3d[2] { s, e };
      Move = new Vector3d[2];
      Weighting = new double[2];
      RestLength = l;
      Stiffness = k;
    }

    public override void Calculate(List<KangarooSolver.Particle> p)
    {
      Vector3d current = p[PIndex[1]].Position - p[PIndex[0]].Position;
      double stretchfactor = 1.0 - RestLength / current.Length;
      Vector3d SpringMove = 0.5 * current * stretchfactor;
      Move[0] = SpringMove;
      Move[1] = -SpringMove;
      Weighting[0] = 2 * Stiffness;
      Weighting[1] = 2 * Stiffness;
    }

    public override object Output(List<KangarooSolver.Particle> p)
    {
      return new Line(p[PIndex[0]].Position, p[PIndex[1]].Position);
    }
  }
# ---------- end length_2 ----------
show_2 = Show(G=mesh_plane.Mesh)
merge_fields = MergeFields(Fields=merge_4)
anchor_2 = Anchor(Point=removeduplicatepts, Strength=10000)
boolean_toggle = BooleanToggle(False)
button = Button()
stream_filter = StreamFilter(Gate=Toggle(True), Stream0=length_line, Stream1=length_2.A)
length_3 = CSharpScript(
    P=divide_curve.Points,
    Field=merge_fields,
    k=Slider(1, range=0..10),
    Reference=["C:\Program Files\Rhino 7\Plug-ins\Grasshopper\Components\Kangaroo2Component.gha", "C:\Program Files\Rhino 7\Plug-ins\Grasshopper\Components\KangarooSolver.dll"])  # -> out, A; inputs P: Point3d, k: Double
# ---------- length_3: C# ----------
    var fields = (List<IGH_FieldElement>) Field;

    A = new FieldForce(P, fields, k);
# ---------- length_3: C# additional code ----------
  public class FieldForce : GoalObject
  {
    public List<IGH_FieldElement> Fields;
    public double Stiffness;

    public FieldForce()
    {
    }

    public FieldForce(int p, List<IGH_FieldElement> f, double k)
    {
      PIndex = new int[1] { p };
      Move = new Vector3d[1];
      Weighting = new double[1];
      Fields = f;
      Stiffness = k;
    }

    public FieldForce(Point3d p, List<IGH_FieldElement> f, double k)
    {
      PPos = new Point3d[1] { p };
      Move = new Vector3d[1];
      Weighting = new double[1];
      Fields = f;
      Stiffness = k;
    }

    public override void Calculate(List<KangarooSolver.Particle> p)
    {
      Point3d pos = p[PIndex[0]].Position;
      Vector3d force = new Vector3d();
      for(int i = 0; i < Fields.Count; i++){
        var Field = Fields[i];
        force += Field.Force(pos);
      }
      //Vector3d current = p[PIndex[1]].Position - p[PIndex[0]].Position;
      //double stretchfactor = 1.0 - RestLength / current.Length;
      //Vector3d SpringMove = 0.5 * current * stretchfactor;
      Move[0] = force;//SpringMove;
      //Move[1] = -SpringMove;
      Weighting[0] = Stiffness;
      //Weighting[1] = 2 * Stiffness;
    }

    public override object Output(List<KangarooSolver.Particle> p)
    {
      //return new Point3d(p[PIndex[0]].Position, p[PIndex[1]].Position);
      return p[PIndex[0]].Position;
    }
  }
# ---------- end length_3 ----------
merge_5 = Merge(Data1=flatten(show), Data2=flatten(rod), Data3=flatten(anchor), Data4=flatten(length_3.A))
merge_6 = Merge(Data1=flatten(show_2), Data2=flatten(stream_filter), Data3=flatten(anchor_2), Data4=flatten(load))
bouncysolver = BouncySolver(
    GoalObjects=merge_5,
    Reset=Button(),
    Threshold=1e-15,
    Tolerance=0.01,
    Damping=0.99,
    Iterations=Slider(1, range=0..10),
    On=Toggle(False))  # -> I, V, O
list_item = ListItem(List=bouncysolver.O, Index=0, Wrap=True)
mesh_pipe = MeshPipe(Curve=list_item, Radius=Slider(1, range=0..1), Accuracy=0.2, Rotation=0, Segments=10, Caps=2)
solver = Solver(GoalObjects=merge_6, Reset=button, Threshold=1e-15, Tolerance=0.01, On=boolean_toggle)  # -> I, V, O; disabled
bouncysolver_2 = BouncySolver(
    GoalObjects=merge_6,
    Reset=button,
    Threshold=1e-15,
    Tolerance=0.01,
    Damping=0.99,
    Iterations=Slider(10, range=0..10),
    On=boolean_toggle)  # -> I, V, O
mesh_normal = MeshNormal(Mesh=mesh_pipe)
list_item_2 = ListItem(List=bouncysolver_2.O, Index=0, Wrap=True)
custom_preview = CustomPreview(Geometry=mesh_normal, Material=ColourSwatch(SwatchColor=RGB(107, 69, 222)))
